# Dynamo graph Auditoría de Cambios Excel vs Revit.dyn (Dynamo 3.6.1.9895)

boolean = BoolSelector(true)
n1_seleccionar_archivo_excel_a = Filename(".\CEMEX_PISSA_Barrio Santa Lucía_Equipos Mecánicos.xlsx")  # "1. Seleccionar archivo Excel a auditar"; graph input
file_from_path = FileObject(path=n1_seleccionar_archivo_excel_a)
categories = Categories("OST_MechanicalEquipment")  # graph input
all_elements_of_category = ElementsOfCategory(Category=categories)
elementType = Element.ElementType(element=all_elements_of_category)
string = StringInput("Marca de tipo")
getParameterValueByName = Element.GetParameterValueByName(element=elementType, parameterName=string)
string_2 = StringInput("Descripción")
getParameterValueByName_2 = Element.GetParameterValueByName(element=elementType, parameterName=string_2)
string_3 = StringInput("Hoja1")
number = DoubleInput(2)
openXMLImportExcel = Data.OpenXMLImportExcel(filePath=n1_seleccionar_archivo_excel_a, sheetName=string_3, startRow=number)
aplicar_cambios_en_revit = BoolSelector(false)  # graph input
python_script = Python(IN[0]=elementType, IN[1]=getParameterValueByName, IN[2]=getParameterValueByName_2, IN[3]=openXMLImportExcel, IN[4]=aplicar_cambios_en_revit)  # CPython3
# ---------- python_script.python (73 lines) ----------
import clr
clr.AddReference('RevitNodes')
import Revit
clr.ImportExtensions(Revit.Elements)

elem_rev = IN[0] if isinstance(IN[0], list) else [IN[0]]
marc_rev = IN[1] if isinstance(IN[1], list) else [IN[1]]
desc_rev = IN[2] if isinstance(IN[2], list) else [IN[2]]
excel_crudo = IN[3]
EJECUTAR = IN[4] 

modificar, valores, reporte = [], [], []

def limpiar(v):
    if v is None: return ""
    return str(v).strip().split('.')[0].zfill(2)

try:
    filas = excel_crudo[0] if (len(excel_crudo) == 1 and isinstance(excel_crudo[0], list)) else excel_crudo
    dict_ex = {}
    for fila in filas:
        if isinstance(fila, list) and len(fila) >= 3:
            dict_ex[limpiar(fila[2])] = {"f": str(fila[0]), "d": str(fila[1]).strip()}

    cambios_agrupados = {}
    total_modificados = 0

    for i in range(len(marc_rev)):
        id_r = limpiar(marc_rev[i])
        txt_r = str(desc_rev[i]).strip() if i < len(desc_rev) and desc_rev[i] else ""
        
        if id_r in dict_ex:
            txt_nuevo = dict_ex[id_r]["d"]
            if txt_r != txt_nuevo and txt_nuevo != "":
                total_modificados += 1
                
                if EJECUTAR:
                    modificar.append(elem_rev[i])
                    valores.append(txt_nuevo)
                
                if id_r in cambios_agrupados:
                    cambios_agrupados[id_r]["conteo"] += 1
                else:
                    cambios_agrupados[id_r] = {
                        "familia": dict_ex[id_r]["f"],
                        "antes": txt_r,
                        "ahora": txt_nuevo,
                        "conteo": 1
                    }

    if not cambios_agrupados:
        reporte.append("Todo en orden. No hay diferencias entre Excel y Revit.")
    else:
        # Aquí cambiamos los textos para que sean 100% claros
        if not EJECUTAR:
            reporte.append("AVISO: MODO AUDITORÍA (Tu modelo de Revit NO fue modificado).")
            reporte.append("Se encontraron " + str(total_modificados) + " diferencias en el Excel, listas para revisión:\n")
        else:
            reporte.append("¡ÉXITO! Los cambios han sido escritos en Revit.")
            reporte.append("Se actualizaron " + str(total_modificados) + " unidades físicas en el modelo:\n")
            
        for marca, datos in cambios_agrupados.items():
            reporte.append("DIFERENCIA -> Marca de tipo: " + marca)
            reporte.append("  Familia y tipo: " + datos["familia"])
            reporte.append("  Unidades en modelo: " + str(datos["conteo"]))
            reporte.append("  Antes (Revit): [" + datos["antes"] + "]")
            reporte.append("  Ahora (Excel): [" + datos["ahora"] + "]")
            reporte.append("-" * 60)
        
except Exception as e:
    reporte.append("Error: " + str(e))

OUT = [modificar, valores, "\n".join(reporte)]
# ----------------------------------------
number_2 = DoubleInput(2)
getItemAtIndex = List.GetItemAtIndex(list=python_script, index=number_2)
watch = Watch(getItemAtIndex)  # graph output
number_3 = DoubleInput(0)
getItemAtIndex_2 = List.GetItemAtIndex(list=python_script, index=number_3)
string_4 = StringInput("Descripción")
number_4 = DoubleInput(1)
getItemAtIndex_3 = List.GetItemAtIndex(list=python_script, index=number_4)
setParameterByName = Element.SetParameterByName(element=getItemAtIndex_2, parameterName=string_4, value=getItemAtIndex_3)
